# Grasshopper definition Waffle Surface.gh (Grasshopper 1.0.7)

range = Range(Domain=Domain(0, 1), Steps=Slider(10, range=5..15))
range_2 = Range(Domain=Domain(0, 1), Steps=Slider(10, range=5..15))
# Input the Python file to this node!
path = FilePath("E:\Youtube Video\4-Waffel Surface 2\file\3 - waffleSrfs part1.py")
graph = GraphMapper(
    range_2,
    x0=0,
    x1=1,
    y0=0,
    y1=1,
    container_name="Bezier",
    cpx=[0, 0.25, 0.7272727489, 1],
    cpy=[0, 0.1956521869, 0.6811593771, 1])
graph_2 = GraphMapper(
    range,
    x0=0,
    x1=1,
    y0=0,
    y1=1,
    container_name="Bezier",
    cpx=[0, 0.3623188436, 0.6521739364, 1],
    cpy=[0, 0.1811594367, 0.8297101259, 1])
panel = Panel(range)
panel_2 = Panel(graph_2)
trigger = Trigger(Interval=-1000, TimerInterval=1000, Target=python)
python = GhPythonScript(
    Code=path,
    XStep=Slider(10, range=0..10),
    YStep=Slider(10, range=0..10),
    U=graph,
    V=graph_2,
    Amp=Slider(6, range=0..10),
    RSeed=Slider(30, range=0..100))  # -> Out, SrfPts, Polys, PolysAO, PolysBO, OutSrfs
geo = Geometry(python.OutSrfs)
panel_3 = Panel(python.Out)
