# Grasshopper definition Bezier Shells.gh (Grasshopper 1.0.7)

recgrid = Rectangular(
    Plane=PlaneXY(0, 0, 0),
    SizeX=Slider(10, range=0..10),
    SizeY=Slider(9, range=0..10),
    ExtentX=Slider(6, range=0..10),
    ExtentY=5)  # -> flatten(Cells), Points
path = FilePath("C:\Users\ots01\Desktop\Week 5\week5.py")
python = GhPythonScript(Code=path, Polys=recgrid.Cells, ZFactor=Slider(0.7, range=0.5..1.5), RSeed=Slider(378, range=0..1000))  # -> Out, Shells
dispatch = Dispatch(List=python.Shells, DispatchPattern=[True, False])  # -> simplify(graft(ListA)), simplify(graft(ListB))
loft = Loft(
    Curves=[dispatch.ListA, dispatch.ListB],
    Options={Adjust=False, Closed=False, LoftEnds=0, LoftSimp=0, LoftType=0, Rebuild=10, Refit=0.01})
panel = Panel(python.Out)
