# Grasshopper definition zahaWav.gh (Grasshopper 1.0.7)

crv = Curve(<curve referenced from the Rhino model>)  # disabled
crv_2 = Curve(<curve referenced from the Rhino model>)  # disabled
crv_3 = Curve(<curve referenced from the Rhino model>)  # disabled
path = FilePath("C:\Users\ots01\Google Drive\Personal Tutorials\YouTube\Week-7\zahaWavSimp.py")
srf = Surface(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)
srf_2 = Surface(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)
merge = Merge(Data1=crv, Data2=crv_2, Data3=crv_3)  # disabled
python = GhPythonScript(Code=path, Srf=srf_2, UNum=Slider(8, range=0..20), VNum=Slider(13, range=0..20), OffDist=Slider(3.1, range=0..10))  # -> Out, Crvs, Srfs
number_slider = Slider(2, range=0..10)  # disabled
number_slider_2 = Slider(7, range=0..20)  # disabled
number_slider_3 = Slider(24, range=0..100)  # disabled
loft = Loft(Curves=merge, Options={Adjust=False, Closed=False, LoftEnds=0, LoftSimp=0, LoftType=0, Rebuild=10, Refit=0.01})  # disabled
srf_3 = Surface(python.Srfs)
panel = Panel(python.Out)
flip = Flip(Surface=loft)  # -> Surface, Result; disabled
path_2 = FilePath("D:\Personal Tutorials\YouTube\Week-7\zahaWavSimp.py")  # disabled
join = BrepJoin(Breps=srf_3)  # -> Breps, Closed
preview = CustomPreview(Geometry=join.Breps, Material=ColourSwatch(SwatchColor=RGB(145, 145, 145)))
python_2 = GhPythonScript(Code=path_2, Srf=flip.Surface, UNum=number_slider_2, VNum=number_slider_3, OffDist=number_slider)  # -> Out, Crvs, Srfs; disabled
srf_4 = Surface(python_2.Srfs)  # disabled
panel_2 = Panel(python_2.Out)  # disabled
swatch = ColourSwatch(SwatchColor=RGB(145, 145, 145))  # disabled
join_2 = BrepJoin(Breps=srf_4)  # -> Breps, Closed; disabled
preview_2 = CustomPreview(Geometry=join_2.Breps, Material=swatch)  # disabled
