# Grasshopper definition hexaPattern.gh (Grasshopper 1.0.7)

path = FilePath("C:\Users\ots01\Desktop\hexaPattern.py")
srf = Surface(<surface referenced from the Rhino model>)
pt = Point(Point(15.35834012, 4.367590936, 0))
python = GhPythonScript(
    Code=path,
    Srf=srf,
    UNum=Slider(6, range=0..10),
    VNum=Slider(33, range=0..100),
    AttrPt=pt,
    Magnitude=Slider(1.8, range=0..10))  # -> Out, A, B, C
panel = Panel(python.Out)
tag = TextTag3D(Location=python.A, Text=python.B, Size=Slider(0.6, range=0..1), Justification=7)
crv = Curve(python.C)
