# Grasshopper definition ghfile.gh (Grasshopper 1.0.7)

hexgrid = Hexagonal(Plane=PlaneXY(0, 0, 0), Size=Slider(5, range=0..10), ExtentX=Slider(11, range=0..100), ExtentY=Slider(11, range=0..100))  # -> flatten(Cells), Points
path = FilePath("C:\Users\ots01\Desktop\009\script.py")
python = GhPythonScript(Code=path, Hexagons=hexgrid.Cells, RSeed=Slider(641, range=0..1000))  # -> Out, Crvs, Srfs
panel = Panel(python.Out)
