# Grasshopper definition voronoi.gh (Grasshopper 1.0.7)

rectangle = Rectangle(Plane=PlaneXY(0, 0, 0), XSize=Slider(60, range=0..100), YSize=Slider(40, range=0..100), Radius=0)  # -> Rectangle, Length
pop2d = Populate2D(Region=rectangle.Rectangle, Count=100, Seed=1)
lng = ListLength(List=pop2d)
multiplication = Multiplication(A=lng, B=Slider(0.6, range=0.1..1))
reduce = RandomReduce(List=pop2d, Reduction=multiplication, Seed=1)
path = FilePath("/Users/tingsongou/Desktop/voronoi.py")
voronoi = Voronoi(Points=reduce, Boundary=rectangle.Rectangle, BruteForceOverride=False)
python = GhPythonScript(Code=path, Cells=voronoi)  # -> Out, NewCells, NewBases
panel = Panel(python.Out)
crv = Curve(python.NewBases)
item = ListItem(List=python.NewCells, Index=0, Wrap=True)  # -> Item, Item1, Item2
graft = GraftTree(Tree=crv, IncludeEmptyLists=True, IncludeNullItems=True)
graft_2 = GraftTree(Tree=voronoi, IncludeEmptyLists=True, IncludeNullItems=True)
panel_2 = Panel(python.NewCells)
merge = Merge(Data1=simplify(graft), Data2=simplify(graft_2))
loft = Loft(
    Curves=[item.Item, item.Item1],
    Options={Adjust=False, Closed=False, LoftEnds=0, LoftSimp=0, LoftType=0, Rebuild=10, Refit=0.01})
loft_2 = Loft(
    Curves=[item.Item2, item.Item],
    Options={Adjust=False, Closed=False, LoftEnds=0, LoftSimp=0, LoftType=0, Rebuild=10, Refit=0.01})
loft_3 = Loft(Curves=merge, Options={Adjust=False, Closed=False, LoftEnds=0, LoftSimp=0, LoftType=0, Rebuild=10, Refit=0.01})
preview = CustomPreview(
    Geometry=[loft, loft_2, loft_3],
    Material={diffuse=RGB(228, 178, 227), emission=RGB(68, 53, 68), shine=0.5, specular=RGB(255, 254, 254), transparency=0})
