# Grasshopper definition pentagon.gh (Grasshopper 1.0.7)
# plug-ins: LunchBox, Pufferfish

line = Line(Line((-15.75411914, 7.563371356, 5.98782615), (-13.38132263, 15.31956118, 5.98782615)))
python = GhPythonScript(line=line, iter=Slider(190, range=0..1000), seed=Slider(463, range=0..1000))  # -> out, a, b; inputs line: Line, seed: Int32
# ---------- python: Python ----------
__author__ = "tingsongou"

import Rhino.Geometry as rg
import random
import ghpythonlib.treehelpers as th
from math import *

random.seed(seed)

#Generating Pentagon
def genPenta(line):
    iter = 0
    oriPts = [line.From, line.To]
    pentaPts = [line.To]
    while iter < 3:
        vec = rg.Point3d.Subtract(line.To, line.From)
        rad = radians(72);
        nextX = vec[0] * cos(rad) - vec[1] * sin(rad);
        nextY = vec[0] * sin(rad) + vec[1] * cos(rad);
        newPt = rg.Point3d(nextX, nextY, 0)
        newPt += line.To
        newLine = rg.Line(line.To, newPt)
        line = newLine
        pentaPts.append(line.To)
        iter += 1
    pentaPts.append(oriPts[0])
    return pentaPts


#Adding Edge to avaliable edge set
def addEdges(pentaPts, edgeSet):
    for i in range(len(pentaPts)):
        ptA = pentaPts[i]
        ptB = pentaPts[(i+1)%len(pentaPts)]
        newEdge = rg.Line(ptA, ptB)
        edgeSet.add(newEdge)


#Moving pts
def movePts(pentaPts):
    newPts = pentaPts[:]
    for i in range(1, len(pentaPts)-1):
        pt = pentaPts[i]
        xOff = random.uniform(-0.7, 0.7)
        yOff = random.uniform(-0.7, 0.7)
        zOff = random.uniform(-1.0, 3.0)
        newPts[i] = rg.Point3d(pt[0] + xOff, pt[1] + yOff, pt[2] + zOff)
    return newPts
        

#Check intersection
def checkIntersection(pentagonA, pentagonB):
    global b
    pPentaA = [rg.Point3d(pt[0], pt[1], 0) for pt in pentagonA]
    pPentaB = [rg.Point3d(pt[0], pt[1], 0) for pt in pentagonB]
    
    #Shorten PolylineA
    tempA = rg.PolylineCurve(pPentaA)
    dom = tempA.Domain
    tempA = tempA.Trim(dom[0] + 0.1, dom[1] - 0.1)
    pPentaA[0] = tempA.PointAtStart
    pPentaA[-1] = tempA.PointAtEnd
    
    #Create Closed Polygons
    polyA = rg.PolylineCurve(pPentaA + [pPentaA[0]])
    polyB = rg.PolylineCurve(pPentaB + [pPentaB[0]])
    
    plane = rg.Plane.WorldXY
    rel = rg.Curve.PlanarClosedCurveRelationship(polyA, polyB, plane, 0.01)
    
    return rel != rg.RegionContainment.Disjoint
    


avalEdges = {line}
pentagons = []
currItr = 0
while currItr < iter:
    currItr += 1
    randEdge = random.choice(list(avalEdges))
    randEdge.Flip()
    newPenta = genPenta(randEdge)
    newPenta = movePts(newPenta)
    
    #Check Collision
    isCollide = False
    for penta in pentagons:
        intersect = checkIntersection(newPenta, penta)
        if intersect: isCollide = True
    if isCollide: continue
    
    pentagons.append(newPenta)
    addEdges(newPenta, avalEdges)
    avalEdges.remove(randEdge)
    

a = th.list_to_tree(pentagons)
# ---------- end python ----------
pline = PolyLine(Vertices=python.a, Closed=Toggle(True))

project = Project(Geometry=pline, Plane=PlaneXY(0, 0, 0))  # -> Geometry, Transform
area = Area(Geometry=project.Geometry)  # -> Area, Centroid
scale = Scale(Geometry=project.Geometry, Center=area.Centroid, Factor=Slider(0.1, range=0..1))  # -> Geometry, Transform
neg = Negative(Value=Slider(0.1, range=0..1))
explode = Explode(Curve=scale.Geometry, Recursive=True)  # -> Segments, Vertices
ext = ExtendCurve(Curve=explode.Segments, Type=0, Start=neg, End=neg)
graft = GraftTree(Tree=ext, IncludeEmptyLists=True, IncludeNullItems=True)

explode_2 = Explode(Curve=pline, Recursive=True)  # -> Segments, Vertices
neg_2 = Negative(Value=Slider(0.2, range=0..1))
ext_2 = ExtendCurve(Curve=explode_2.Segments, Type=0, Start=neg_2, End=neg_2)
graft_2 = GraftTree(Tree=ext_2, IncludeEmptyLists=True, IncludeNullItems=True)

tweencrv = TweenCurve(CurveA=pline, CurveB=scale.Geometry, Factor=Slider(0.3, range=0..1), BlendType=0)
explode_3 = Explode(Curve=tweencrv, Recursive=True)  # -> Segments, Vertices
cull_i = CullIndex(List=explode_3.Vertices, Indices="-1", Wrap=True)
avr = Average(Input=cull_i)
scale_2 = Scale(Geometry=tweencrv, Center=avr, Factor=0.5)  # -> Geometry, Transform
explode_4 = Explode(Curve=scale_2.Geometry, Recursive=True)  # -> Segments, Vertices
neg_3 = Negative(Value=Slider(0.2, range=0..1))
ext_3 = ExtendCurve(Curve=explode_4.Segments, Type=0, Start=neg_3, End=neg_3)
graft_3 = GraftTree(Tree=ext_3, IncludeEmptyLists=True, IncludeNullItems=True)

neg_4 = Negative(Value=Slider(0.25, range=0..1))
srf = Surface(project.Geometry)
Z = UnitZ(Factor=neg_4)
extr = Extrude(Base=srf, Direction=Z)
merge = Merge(Data1=simplify(graft_2), Data2=simplify(graft_3), Data3=simplify(graft))
loft = Loft(Curves=merge, Options={Adjust=False, Closed=False, LoftEnds=0, LoftSimp=0, LoftType=0, Rebuild=10, Refit=0.01})  # disabled
offsrf = OffsetSurface(Surface=loft, Distance=Slider(0.25, range=0..1), BothSides=False, CreateSolid=True)  # -> simplify(Offset)
pshift = ShiftPaths(Data=offsrf, Offset=-1)
group = Group(Objects=pshift)  # -> flatten(Group)
randomsplit = RandomSplitList(MasterList=group, Seed=2, Split=Slider(0.25, range=0..1))  # -> ListA, ListB
randomsplit_2 = RandomSplitList(MasterList=randomsplit.ListA, Seed=2, Split=Slider(0.25, range=0..1))  # -> ListA, ListB
randomsplit_3 = RandomSplitList(MasterList=randomsplit_2.ListA, Seed=2, Split=Slider(0.25, range=0..1))  # -> ListA, ListB
geo = Geometry(randomsplit.ListB)
geo_2 = Geometry(randomsplit_2.ListB)
geo_3 = Geometry(randomsplit_3.ListA)
geo_4 = Geometry(randomsplit_3.ListB)
