# Grasshopper definition leaves.gh (Grasshopper 1.0.7)

crv = Curve([<curve referenced from the Rhino model> x5])
path = FilePath("/Users/tingsongou/Desktop/leaves.py")
python = GhPythonScript(
    Code=path,
    Curves=crv,
    AFac=Slider(0.6, range=0..1),
    BFac=Slider(3.9, range=0..10),
    Step=Slider(0.13, range=0.1..0.3),
    RSeed=Slider(608, range=0..1000))  # -> Out, A, B
panel = Panel(python.Out)
