# Grasshopper definition Euclidean Panels.gh (Grasshopper 1.0.7)
# plug-ins: Kangaroo2 Components, Pufferfish

path = FilePath("D:\Personal Tutorials\YouTube\Week-6\codeFile-recursive.py")
python = GhPythonScript(Code=path, X=Slider(10, range=0..10), Y=Slider(6, range=0..10), Limit=Slider(72, range=0..1000))  # -> Out, A
split = SplitList(List=python.A, Index=Slider(1, range=0..1))  # -> ListA, ListB
explode = Explode(Curve=split.ListB, Recursive=True)  # -> flatten(Segments), Vertices
dupln = RemoveDuplicateLines(Lines=explode.Segments, Tolerance=0.01)
crv = Curve(split.ListA)
boundary = BoundarySurfaces(Edges=crv)
srfsplit = SurfaceSplit(Surface=boundary, Curves=dupln)

explode_2 = Explode(Curve=srfsplit, Recursive=True)  # -> simplify(Segments), Vertices; disabled
number_slider = Slider(1, range=0..1)  # disabled
number_slider_2 = Slider(1.5, range=1..2)  # disabled
number_slider_3 = Slider(0.3, range=0..1)  # disabled
join = JoinCurves(Curves=explode_2.Segments, Preserve=False)  # disabled
toggle = BooleanToggle(True)  # disabled
redpline = Reduce(Polyline=join, Tolerance=1)  # -> flatten(Polyline), Reduction; disabled
neg = Negative(Value=number_slider)  # disabled
multiplication = Multiplication(A=number_slider, B=number_slider_2)  # disabled
offsrf = OffsetSurface(Surface=srfsplit, Distance=number_slider_3, BothSides=toggle, CreateSolid=True)  # disabled
offset = OffsetCurve(Curve=redpline.Polyline, Distance=neg, Corners=1)  # disabled
graft = GraftTree(Tree=redpline.Polyline, IncludeEmptyLists=True, IncludeNullItems=True)  # -> simplify(graft(Tree)); disabled
graft_2 = GraftTree(Tree=offset, IncludeEmptyLists=True, IncludeNullItems=True)  # -> simplify(Tree); disabled
toggle_2 = BooleanToggle(True)  # disabled
loft = Loft(
    Curves=[graft, graft_2],
    Options={Adjust=False, Closed=False, LoftEnds=0, LoftSimp=0, LoftType=0, Rebuild=10, Refit=0.01})  # disabled
offsrf_2 = OffsetSurface(Surface=loft, Distance=multiplication, BothSides=toggle_2, CreateSolid=True)  # disabled
geo = Geometry(flatten(offsrf))  # disabled
geo_2 = Geometry(offsrf_2)  # disabled

number_slider_4 = Slider(826, range=0..1000)  # disabled
python_2 = GhPythonScript(objs=geo, rSeed=number_slider_4)  # -> out, a, b, c, d; inputs objs: list; disabled
# ---------- python_2: Python ----------
__author__ = "ots01"
__version__ = "2021.07.29"

import rhinoscriptsyntax as rs
from random import randint, seed

seed(rSeed)

a = []
b = []
c = []
d= []

for obj in objs:
    randVal = randint(0, 3)
    if randVal == 0:
        a.append(obj)
    elif randVal == 1:
        b.append(obj)
    elif randVal == 2:
        c.append(obj)
    else: d.append(obj)
# ---------- end python_2 ----------
geo_3 = Geometry(python_2.a)  # disabled
geo_4 = Geometry(python_2.b)  # disabled
geo_5 = Geometry(python_2.d)  # disabled
geo_6 = Geometry(python_2.c)  # disabled
